# Grasshopper definition topoSpeckle.ghx (Grasshopper 1.0.7)
# plug-ins: Speckle 2

rendermaterial = RenderMaterial(
    Opacity="1",
    Metalness="0",
    Roughness="1",
    Diffuse=ColourSwatch(SwatchColor=RGB(199, 199, 199)),
    SelectedConstructorName="Objects.Other.RenderMaterial.ctor(System.Double,System.Double,System.Double,System.Nullable`1[System.Drawing.Color],System.Nullable`1[System.Drawing.Color])",
    SelectedTypeName="Objects.Other.RenderMaterial",
    UseSchemaTag=False,
    UserSetSchemaTag=False,
    seed="621402ed835097216427")
rendermaterial_2 = RenderMaterial(
    Opacity="1",
    Metalness="0",
    Roughness="1",
    Diffuse=ColourSwatch(SwatchColor=RGB(122, 122, 122)),
    SelectedConstructorName="Objects.Other.RenderMaterial.ctor(System.Double,System.Double,System.Double,System.Nullable`1[System.Drawing.Color],System.Nullable`1[System.Drawing.Color])",
    SelectedTypeName="Objects.Other.RenderMaterial",
    UseSchemaTag=False,
    UserSetSchemaTag=False,
    seed="203aa48e2cb00c0caa01")
rendermaterial_3 = RenderMaterial(
    Opacity="1",
    Metalness="0",
    Roughness="1",
    Diffuse=ColourSwatch(SwatchColor=RGB(199, 199, 199)),
    SelectedConstructorName="Objects.Other.RenderMaterial.ctor(System.Double,System.Double,System.Double,System.Nullable`1[System.Drawing.Color],System.Nullable`1[System.Drawing.Color])",
    SelectedTypeName="Objects.Other.RenderMaterial",
    UseSchemaTag=False,
    UserSetSchemaTag=False,
    seed="957bce11b6189a06f26d")
rendermaterial_4 = RenderMaterial(
    Opacity="1",
    Metalness="0",
    Roughness="1",
    Diffuse=ColourSwatch(SwatchColor=RGB(193, 9, 235)),
    SelectedConstructorName="Objects.Other.RenderMaterial.ctor(System.Double,System.Double,System.Double,System.Nullable`1[System.Drawing.Color],System.Nullable`1[System.Drawing.Color])",
    SelectedTypeName="Objects.Other.RenderMaterial",
    UseSchemaTag=False,
    UserSetSchemaTag=False,
    seed="171296fe02e1b90dbac8")
rendermaterial_5 = RenderMaterial(
    Opacity="1",
    Metalness="0",
    Roughness="1",
    Diffuse=ColourSwatch(SwatchColor=RGB(122, 122, 122)),
    SelectedConstructorName="Objects.Other.RenderMaterial.ctor(System.Double,System.Double,System.Double,System.Nullable`1[System.Drawing.Color],System.Nullable`1[System.Drawing.Color])",
    SelectedTypeName="Objects.Other.RenderMaterial",
    UseSchemaTag=False,
    UserSetSchemaTag=False,
    seed="1189eb6bb6f8a1259360")
rendermaterial_6 = RenderMaterial(
    Opacity="1",
    Metalness="0",
    Roughness="1",
    Diffuse=ColourSwatch(SwatchColor=RGB(201, 201, 201)),
    SelectedConstructorName="Objects.Other.RenderMaterial.ctor(System.Double,System.Double,System.Double,System.Nullable`1[System.Drawing.Color],System.Nullable`1[System.Drawing.Color])",
    SelectedTypeName="Objects.Other.RenderMaterial",
    UseSchemaTag=False,
    UserSetSchemaTag=False,
    seed="a733d1989930408f1873")
rendermaterial_7 = RenderMaterial(
    Opacity="1",
    Metalness="0",
    Roughness="1",
    Diffuse=ColourSwatch(SwatchColor=RGB(189, 189, 189)),
    SelectedConstructorName="Objects.Other.RenderMaterial.ctor(System.Double,System.Double,System.Double,System.Nullable`1[System.Drawing.Color],System.Nullable`1[System.Drawing.Color])",
    SelectedTypeName="Objects.Other.RenderMaterial",
    UseSchemaTag=False,
    UserSetSchemaTag=False,
    seed="c65aab5024e53213a342")
rendermaterial_8 = RenderMaterial(
    Opacity="1",
    Metalness="0",
    Roughness="1",
    Diffuse=ColourSwatch(SwatchColor=RGB(178, 178, 178)),
    SelectedConstructorName="Objects.Other.RenderMaterial.ctor(System.Double,System.Double,System.Double,System.Nullable`1[System.Drawing.Color],System.Nullable`1[System.Drawing.Color])",
    SelectedTypeName="Objects.Other.RenderMaterial",
    UseSchemaTag=False,
    UserSetSchemaTag=False,
    seed="e2656b01266e4fc7e95d")
python = GhPythonScript()  # -> out
# ---------- python: Python ----------
__author__ = "RivinduB"
__version__ = "2023.08.03"

import rhinoscriptsyntax as rs
import Rhino

my_doc = Rhino.RhinoDoc.CreateHeadless(None)
my_doc.ModelUnitSystem = Rhino.UnitSystem.Meters
Rhino.RhinoDoc.ActiveDoc = my_doc
# ---------- end python ----------
boundary = GetGeometry(AtLeast=1, AtMost=2147483647, DeleteInput=False, Filter=1074004029, TreeAccess=True)
mesh = GetGeometry(AtLeast=1, AtMost=2147483647, DeleteInput=False, Filter=1074004029, TreeAccess=True)
buildings = GetGeometry(AtLeast=1, AtMost=2147483647, DeleteInput=False, Filter=1074004029, TreeAccess=True)
roads = GetGeometry(AtLeast=1, AtMost=2147483647, DeleteInput=False, Filter=1074004029, TreeAccess=True)
contours = GetGeometry(AtLeast=1, AtMost=2147483647, DeleteInput=False, Filter=1074004029, TreeAccess=True)
elevatedbuildings = GetGeometry(AtLeast=1, AtMost=2147483647, DeleteInput=False, Filter=1074004029, TreeAccess=True)
heritage = GetGeometry(AtLeast=1, AtMost=2147483647, DeleteInput=False, Filter=1074004029, TreeAccess=True)
isochrone = GetGeometry(AtLeast=1, AtMost=2147483647, DeleteInput=False, Filter=1074004029, TreeAccess=True)
lots = GetGeometry(AtLeast=1, AtMost=2147483647, DeleteInput=False, Filter=1074004029, TreeAccess=True)
streamid = GetString(AtLeast=1, AtMost=2147483647, TreeAccess=True)
revittopography = RevitTopography(
    DisplayMesh=mesh,
    SelectedConstructorName="Objects.BuiltElements.Revit.RevitTopography.ctor(Objects.Geometry.Mesh,System.Collections.Generic.List`1[Objects.BuiltElements.Revit.Parameter])",
    SelectedTypeName="Objects.BuiltElements.Revit.RevitTopography",
    UseSchemaTag=False,
    UserSetSchemaTag=False,
    seed="1a35f28e0ab8cd1c6664")
modelcurve = ModelCurve(
    BaseCurve=boundary,
    SelectedConstructorName="Objects.BuiltElements.Revit.Curve.ModelCurve.ctor(Objects.ICurve,System.String,System.Collections.Generic.List`1[Objects.BuiltElements.Revit.Parameter])",
    SelectedTypeName="Objects.BuiltElements.Revit.Curve.ModelCurve",
    UseSchemaTag=False,
    UserSetSchemaTag=False,
    seed="53ddc0490c0bce93b837")
modelcurve_2 = ModelCurve(
    BaseCurve=contours,
    LineStyle="DDG_Contours",
    SelectedConstructorName="Objects.BuiltElements.Revit.Curve.ModelCurve.ctor(Objects.ICurve,System.String,System.Collections.Generic.List`1[Objects.BuiltElements.Revit.Parameter])",
    SelectedTypeName="Objects.BuiltElements.Revit.Curve.ModelCurve",
    UseSchemaTag=False,
    UserSetSchemaTag=False,
    seed="ed219971c30e3abf0826")
modelcurve_3 = ModelCurve(
    BaseCurve=roads,
    LineStyle="DDG_Roads",
    SelectedConstructorName="Objects.BuiltElements.Revit.Curve.ModelCurve.ctor(Objects.ICurve,System.String,System.Collections.Generic.List`1[Objects.BuiltElements.Revit.Parameter])",
    SelectedTypeName="Objects.BuiltElements.Revit.Curve.ModelCurve",
    UseSchemaTag=False,
    UserSetSchemaTag=False,
    seed="cae901f2f954885ff7ee")
modelcurve_4 = ModelCurve(
    BaseCurve=lots,
    LineStyle="DDG_Lots",
    SelectedConstructorName="Objects.BuiltElements.Revit.Curve.ModelCurve.ctor(Objects.ICurve,System.String,System.Collections.Generic.List`1[Objects.BuiltElements.Revit.Parameter])",
    SelectedTypeName="Objects.BuiltElements.Revit.Curve.ModelCurve",
    UseSchemaTag=False,
    UserSetSchemaTag=False,
    seed="3dbc0a5319c336bb4c13")
modelcurve_5 = ModelCurve(
    BaseCurve=isochrone,
    LineStyle="DDG_Isochrone",
    SelectedConstructorName="Objects.BuiltElements.Revit.Curve.ModelCurve.ctor(Objects.ICurve,System.String,System.Collections.Generic.List`1[Objects.BuiltElements.Revit.Parameter])",
    SelectedTypeName="Objects.BuiltElements.Revit.Curve.ModelCurve",
    UseSchemaTag=False,
    UserSetSchemaTag=False,
    seed="8efc303e0747b9574657")
modelcurve_6 = ModelCurve(
    BaseCurve=heritage,
    LineStyle="DDG_Parks",
    SelectedConstructorName="Objects.BuiltElements.Revit.Curve.ModelCurve.ctor(Objects.ICurve,System.String,System.Collections.Generic.List`1[Objects.BuiltElements.Revit.Parameter])",
    SelectedTypeName="Objects.BuiltElements.Revit.Curve.ModelCurve",
    UseSchemaTag=False,
    UserSetSchemaTag=False,
    seed="1a051330469f8f8310d9")
accst = AccountFromServerToken(Server="https://speckle.xyz/", AuthToken="091eabd976672b05e476e09b315f8bc1a254de4ca0")
parameter = Parameter(
    Name="Comments",
    Value="Buildings Elevated",
    SelectedConstructorName="Objects.BuiltElements.Revit.Parameter.ctor(System.String,System.Object,System.String)",
    SelectedTypeName="Objects.BuiltElements.Revit.Parameter",
    UseSchemaTag=False,
    UserSetSchemaTag=False,
    seed="7270b0e9ebe80b471156")
parameter_2 = Parameter(
    Name="Comments",
    Value="Buildings",
    SelectedConstructorName="Objects.BuiltElements.Revit.Parameter.ctor(System.String,System.Object,System.String)",
    SelectedTypeName="Objects.BuiltElements.Revit.Parameter",
    UseSchemaTag=False,
    UserSetSchemaTag=False,
    seed="b3b46e60aa49b845e935")
freeform_element = FreeformElement(
    BaseGeometries=flatten(elevatedbuildings),
    Subcategory="Buildings Elevated",
    Parameters=parameter,
    SelectedConstructorName="Objects.BuiltElements.Revit.FreeformElement.ctor(System.Collections.Generic.List`1[Speckle.Core.Models.Base],System.String,System.Collections.Generic.List`1[Objects.BuiltElements.Revit.Parameter])",
    SelectedTypeName="Objects.BuiltElements.Revit.FreeformElement",
    UseSchemaTag=False,
    UserSetSchemaTag=False,
    seed="83416a0d9a51ad412098")
sget = StreamGet(StreamIDURL=flatten(streamid), SpeckleAccount=accst)
freeform_element_2 = FreeformElement(
    BaseGeometries=flatten(buildings),
    Subcategory="Buildings",
    Parameters=parameter_2,
    SelectedConstructorName="Objects.BuiltElements.Revit.FreeformElement.ctor(System.Collections.Generic.List`1[Speckle.Core.Models.Base],System.String,System.Collections.Generic.List`1[Objects.BuiltElements.Revit.Parameter])",
    SelectedTypeName="Objects.BuiltElements.Revit.FreeformElement",
    UseSchemaTag=False,
    UserSetSchemaTag=False,
    seed="0cc693cf37a45405af5c")
to_speckle = ToSpeckle(Data=flatten(boundary), preprocessGeometry=False, selectedKitName="Objects")
to_speckle_2 = ToSpeckle(Data=flatten(modelcurve_5), preprocessGeometry=False, selectedKitName="Objects")
to_speckle_3 = ToSpeckle(Data=flatten(modelcurve_2), preprocessGeometry=False, selectedKitName="Objects")
to_speckle_4 = ToSpeckle(Data=flatten(modelcurve_3), preprocessGeometry=False, selectedKitName="Objects")
to_speckle_5 = ToSpeckle(Data=flatten(modelcurve_4), preprocessGeometry=False, selectedKitName="Objects")
to_speckle_6 = ToSpeckle(Data=flatten(modelcurve_6), preprocessGeometry=False, selectedKitName="Objects")
to_speckle_7 = ToSpeckle(Data=flatten(freeform_element), preprocessGeometry=False, selectedKitName="Objects")
to_speckle_8 = ToSpeckle(Data=flatten(freeform_element_2), preprocessGeometry=False, selectedKitName="Objects")
eso = ExtendSpeckleObject(SpeckleObject=to_speckle, RenderMaterial=rendermaterial, selectedKitName="Objects")
eso_2 = ExtendSpeckleObject(SpeckleObject=to_speckle_2, RenderMaterial=rendermaterial_4, selectedKitName="Objects")
eso_3 = ExtendSpeckleObject(SpeckleObject=to_speckle_3, RenderMaterial=rendermaterial_6, selectedKitName="Objects")
eso_4 = ExtendSpeckleObject(SpeckleObject=to_speckle_4, RenderMaterial=rendermaterial_7, selectedKitName="Objects")
eso_5 = ExtendSpeckleObject(SpeckleObject=to_speckle_5, RenderMaterial=rendermaterial_8, selectedKitName="Objects")
eso_6 = ExtendSpeckleObject(SpeckleObject=to_speckle_6, RenderMaterial=rendermaterial_3, selectedKitName="Objects")
eso_7 = ExtendSpeckleObject(SpeckleObject=to_speckle_8, RenderMaterial=rendermaterial_5, selectedKitName="Objects")
eso_8 = ExtendSpeckleObject(SpeckleObject=to_speckle_7, RenderMaterial=rendermaterial_2, selectedKitName="Objects")
to_speckle_9 = ToSpeckle(Data=flatten(revittopography), preprocessGeometry=False, selectedKitName="Objects")
ss = SynchronousSender(Data=eso_2, Stream=sget, Message="Isochrones", UseDefaultCache=True, selectedKitName="Objects")
ss_2 = SynchronousSender(
    Data=to_speckle_9,
    Stream=sget,
    Message="Topography",
    OutputWrappers="https://speckle.xyz\t6928d0bb9a\t165eb6dcd1",
    UseDefaultCache=True,
    selectedKitName="Objects")
ss_3 = SynchronousSender(
    Data=eso_7,
    Stream=sget,
    Message="Buildings",
    OutputWrappers="https://speckle.xyz\t833c312f80\t0616e71eb6",
    UseDefaultCache=True,
    selectedKitName="Objects")
ss_4 = SynchronousSender(
    Data=eso_3,
    Stream=sget,
    Message="Contours",
    OutputWrappers="https://speckle.xyz\t833c312f80\td4c20c6f95",
    UseDefaultCache=True,
    selectedKitName="Objects")
ss_5 = SynchronousSender(
    Data=eso_4,
    Stream=sget,
    Message="Roads",
    OutputWrappers="https://speckle.xyz\t833c312f80\td4c20c6f95",
    UseDefaultCache=True,
    selectedKitName="Objects")
ss_6 = SynchronousSender(
    Data=eso_5,
    Stream=sget,
    Message="Lots",
    OutputWrappers="https://speckle.xyz\t833c312f80\td4c20c6f95",
    UseDefaultCache=True,
    selectedKitName="Objects")
ss_7 = SynchronousSender(
    Data=eso_6,
    Stream=sget,
    Message="Heritage",
    OutputWrappers="https://speckle.xyz\t833c312f80\td4c20c6f95",
    UseDefaultCache=True,
    selectedKitName="Objects")
ss_8 = SynchronousSender(Data=eso_8, Stream=sget, Message="Buildings Elevated", UseDefaultCache=True, selectedKitName="Objects")
ss_9 = SynchronousSender(Data=eso, Stream=sget, Message="Boundary", UseDefaultCache=True, selectedKitName="Objects")

# ---- group: RH_OUT:Stream
txt = Text(ss_2)
